# Grasshopper definition angkor.gh (Grasshopper 0.9.14)

seed1 = Slider(9, range=2..50)
density = Slider(2, range=1..20)
simmetry = Slider(1, range=1..6)
seed2 = Slider(50, range=2..50)
stroke = Slider(2, range=0.2..2)
num = Number(density)
num_2 = Number(seed2)
num_3 = Number(seed1)
cir = Circle(Plane=PlaneXY(0, 0, 0), Radius=20)
eval = Evaluate(F="(x*2)-0.03", x=stroke)
eval_2 = Evaluate(F="360/x", x=simmetry)
len = Length(Curve=cir)
series = Series(Start=0, Step=eval_2, Count=simmetry)
eval_3 = Evaluate(F="x-10", x=len)
dom = Domain(DomainStart=0, DomainEnd=len)
eval_4 = Evaluate(F="0.25 + ((1 + sin(x*y)) / 2)")
dom_2 = Domain(DomainStart=10, DomainEnd=eval_3)
random = Random(Range=dom, Number=num, Seed=num_3)
mesh_cylinder_vb = VBScript(x=stroke, y=eval_4)  # -> out, A
# ---------- mesh_cylinder_vb: VB ----------
    Dim radius As Double
    Dim height As Double
    radius = x
    height = y
    Dim circle As Circle
    Dim cylinder As Cylinder
    Dim mesh As Mesh
    'New Rhino.Geometry.Circle(
    circle = New Rhino.Geometry.Circle(radius)
    cylinder = New Rhino.Geometry.Cylinder(circle, height)
    mesh = Rhino.Geometry.Mesh.CreateFromCylinder(cylinder, 1, 9)
    A = RhinoDoc.ActiveDoc.Objects.AddMesh(mesh)
# ---------- end mesh_cylinder_vb ----------
random_2 = Random(Range=dom_2, Number=num, Seed=num_2)
rad = Radians(Degrees=series)  # -> graft(Radians)
addition = Addition(A=random, B=random_2)
hframe = HorizontalFrame(Curve=cir, Parameter=random)
hframe_2 = HorizontalFrame(Curve=cir, Parameter=addition)
ln = Line(StartPoint=hframe, EndPoint=hframe_2)
crv = Curve(ln)
divlength = DivideLength(Curve=crv, Length=eval)  # -> Points, Tangents, Parameters
move = Move(Geometry=mesh_cylinder_vb.A, Motion=divlength.Points)  # -> simplify(flatten(Geometry)), Transform
rotate = Rotate(Geometry=move.Geometry, Angle=rad, Plane=PlaneXY(0, 0, 0))  # -> Geometry, Transform
