# Grasshopper definition another.gh (Grasshopper 0.9.6)
# plug-ins: Python Interpreter, WeaverBird

slider = Slider(6, range=3..8)
c_script = CSharpScript()  # -> out, A
# ---------- c_script: C# ----------
    A = @"C:\inetpub\ftproot\Rendering_Data\GH_Def_files\args_" + System.Diagnostics.Process.GetCurrentProcess().Id + ".txt";
# ---------- end c_script ----------
file = ReadFile(Path=c_script.A, Lines=True)
series = Series(Start=slider, Step=Slider(2.946, range=0.3..3), Count=Slider(3, range=1..10))
addition = Addition(A=Slider(2.2, range=0..6), B=series)
multiplication = Multiplication(A=slider, B=3)
polygon = Polygon(Plane=PlaneXY(0, 0, 0), Radius=series, Segments=slider, FilletRadius=0)  # -> graft(Polygon), Length
item = ListItem(List=file, Index=0, Wrap=False)
polygon_2 = Polygon(Plane=PlaneXY(0, 0, 0), Radius=addition, Segments=slider, FilletRadius=0)  # -> graft(Polygon), Length
multiplication_2 = Multiplication(A=item, B=10)
rdiff = RegionDifference(CurvesA=polygon_2.Polygon, CurvesB=polygon.Polygon)
divide = DivideCurve(Curve=polygon_2.Polygon, Count=multiplication, Kinks=False)  # -> Points, Tangents, Parameters
divide_2 = DivideCurve(Curve=polygon.Polygon, Count=multiplication, Kinks=False)  # -> Points, Tangents, Parameters
ln = Line(StartPoint=divide_2.Points, EndPoint=divide.Points)
python = PythonScript(x=ln)  # -> out, a; inputs x: list
# ---------- python: Python ----------
import rhinoscriptsyntax as rs
a=[]
x.append(x[0])
for i in range(len(x)-1):
    #l1 = rs.AddLine(rs.CurveStartPoint(x[i]),rs.CurveStartPoint(x[i+1]))
    l = rs.AddPolyline([rs.CurveStartPoint(x[i]),rs.CurveStartPoint(x[i+1]),rs.CurveEndPoint(x[i+1]),rs.CurveEndPoint(x[i]),rs.CurveStartPoint(x[i])])
    a.append(l)
# ---------- end python ----------
planar = PlanarSrf(Edges=python.a)
smesh = SimpleMesh(Brep=planar)
mjoin = MeshJoin(Meshes=smesh)
wbcatmullclark = WeaverBirdsCatmullClarkSubdivision(MeshCurves=mjoin, Level=1, SmoothNakedEdges=1)
wbcarpet = WeaverBirdsSierpinskiCarpet(MeshPolylines=wbcatmullclark, Distance=20, InsetType=0)
wbthicken = WeaverBirdsMeshThicken(Mesh=wbcarpet, Distance=1, OffsetType=0)
all = WeaverBirdsCatmullClarkSubdivision(MeshCurves=wbthicken, Level=3, SmoothNakedEdges=1)
Z = UnitZ(Factor=2)
move = Move(Geometry=all, Motion=Z)  # -> Geometry, Transform
