# Grasshopper definition voronoi_tiles_pendant_text.gh (Grasshopper 0.9.14)
# plug-ins: WeaverBird

center_x = Slider(15, range=0..20)
front_location_y = Slider(11.5, range=0..100)
textparam = String("A")
a0 = Number(0.8)

# ---- group: Size
size_front = Slider(7.5, range=0..11)

# ----
a1 = Number(4)
a2 = Number(27)
a3 = Number(7)
toggle_bold = BooleanToggle(True)
join = StringJoin(Strings=textparam)
font = String("Comic Sans MS")
custom_mesh_settings = SettingsCustom(
    StitchSeams=True,
    SimplePlanes=False,
    Refine=invert(True),
    MinCount=16,
    MaxCount=400,
    AspectRatio=10,
    MaxDistance=0,
    MaxAngle=20,
    MinEdge=0.2,
    MaxEdge=0.6)
cluster = Cluster(face=font, bold=toggle_bold, content=join, size=size_front, center_x=center_x, center_y=front_location_y)
extr = Extrude(Base=cluster, Direction=Vector(0, 0, 3))
jagged = SettingsSpeed()
mesh = MeshBrep(Brep=extr, Settings=custom_mesh_settings)
wbsplitquads = WeaverBirdsConstantQuadsSubdivision(MeshCurves=mesh, Level=1, SmoothNakedEdges=1)  # disabled
wbcatmullclark = WeaverBirdsCatmullClarkSubdivision(MeshCurves=mesh, Level=1, SmoothNakedEdges=1)  # disabled
wblaplace = WeaverBirdsLaplacianSmoothing(MeshCurves=mesh, Level=3, SmoothNakedEdges=1, Thin=1)  # -> flatten(OutputMeshCurves)
bbox = BoundingBox(Content=wblaplace, Plane=PlaneXY(0, 0, 0), UnionBox=True)  # -> Box, Box_2; disabled
smesh = SimpleMesh(Brep=bbox.Box)  # disabled
wbfacepolys = WeaverBirdsFacePolylines(Mesh=smesh)  # disabled
all = Geometry(wblaplace)
item = ListItem(List=wbfacepolys, Index=4, Wrap=False)  # disabled
offset = Offset(Curve=item, Distance=-1, Plane=PlaneXY(0, 0, 0), Corners=1)  # disabled
extr_2 = Extrude(Base=offset, Direction=Vector(0, 0, 2.6))  # disabled
cap = CapHoles(Brep=extr_2)  # disabled
bbox_2 = BoundingBox(Content=cap, Plane=PlaneXY(0, 0, 0), UnionBox=True)  # -> Box, Box_2; disabled
mbox = MeshBox(Base=bbox_2.Box, XCount=30, YCount=10, ZCount=20)  # disabled
wblaplace_2 = WeaverBirdsLaplacianSmoothing(MeshCurves=mbox, Level=2, SmoothNakedEdges=1, Thin=1)  # disabled

# ==== cluster Cluster
center_y = ClusterInput()
size = ClusterInput()
center_x = ClusterInput()
face = ClusterInput()
bold = ClusterInput()
content = ClusterInput()
bool = Boolean(False)
extrusion_vec = Vector(Vector(0, 0, 4.5))
max_width = Number(26)
center = Point(Point(15, 14.5, 0))
servers_text_component = Servers_Text_Component(face=face, bold=bold, italics=bool, size=size, content=content)  # -> out, A
# ---------- servers_text_component: VB ----------
    If(size = 0) Then
      size = 1
    End If


    Dim letters_plane As Rhino.Geometry.Plane
    letters_plane = Rhino.Geometry.Plane.WorldXY

    If(face <> Nothing And size > 0 And content <> Nothing) Then
      Dim te As System.Guid
      te = RhinoDoc.ActiveDoc.Objects.AddText(content, letters_plane, size, face, bold, italics)

      Dim txt As Rhino.DocObjects.TextObject
      txt = RhinoDoc.ActiveDoc.Objects.Find(te)

      Dim tt As Rhino.Geometry.TextEntity
      tt = txt.Geometry

      Dim curves() As Rhino.Geometry.Curve
      curves = tt.Explode()

      Dim curvesNum As Integer
      curvesNum = curves.GetUpperBound(0)


      Dim guids(curvesNum) As Guid
      For i As Integer = 0 To curvesNum
        Dim g As Guid
        g = RhinoDoc.ActiveDoc.Objects.AddCurve(curves(i))
        guids(i) = g
      Next
      A = guids
      RhinoDoc.ActiveDoc.Objects.Delete(te, True)
    End If
# ---------- end servers_text_component ----------
crv = Curve(servers_text_component.A)
Z = UnitZ(Factor=extrusion_vec)
planar = PlanarSrf(Edges=crv)
extr = Extrude(Base=planar, Direction=Z)
cap = CapHoles(Brep=extr)
bbox = BoundingBox(Content=cap, Plane=PlaneXY(0, 0, 0), UnionBox=True)  # -> Box, Box_2
explode = BrepComponents(Brep=bbox.Box)  # -> Faces, Edges, Vertices
pcen = PolygonCenter(Polyline=explode.Faces)  # -> CenterV, CenterE
item = ListItem(List=pcen.CenterV, Index=Slider(4, range=0..10), Wrap=False)
item_2 = ListItem(List=pcen.CenterV, Index=Slider(1, range=0..10), Wrap=False)
item_3 = ListItem(List=pcen.CenterV, Index=Slider(3, range=0..10), Wrap=False)
pcomp = Decompose(Point=item_2, System=PlaneXY(0, 0, 0))  # -> XComponent, YComponent, ZComponent
pcomp_2 = Decompose(Point=item_3, System=PlaneXY(0, 0, 0))  # -> XComponent, YComponent, ZComponent
subtraction = Subtraction(A=center, B=item)
move = Move(Geometry=planar, Motion=subtraction)  # -> Geometry, Transform
subtraction_2 = Subtraction(A=pcomp.XComponent, B=pcomp_2.XComponent)
eval = Evaluate(F="min(1.4,y/x)", x=subtraction_2, y=max_width)
scale = Scale(Geometry=move.Geometry, Center=center, Factor=eval)  # -> Geometry, Transform
G = ClusterOutput(scale.Geometry)
